# Dynamo graph run.dyn (Dynamo 3.3.0.6316)
# packages: archi-lab.net 2025.300.1225

number = DoubleInput(1139274)  # graph input
byElementId = archilab.Revit.Selection.Select.ByElementId(id=number)
delete = archilab.Revit.Elements.Elements.Delete(element=byElementId)
watch = Watch(delete)  # graph output
